# Dynamo graph Tekla.dyn (Dynamo 1.3.0.875)

activeDocument = TeklaTools.TeklaTools.ActiveDocument()
code_block = CodeBlock { {0,6000}; }
byCoordinates = Point.ByCoordinates(x=code_block)
code_block_2 = CodeBlock(lst=byCoordinates) { lst[0]; lst[1]; }
activeDocument_2 = TeklaTools.TeklaTools.ActiveDocument(arg1=code_block_2.out0, arg2=code_block_2.out1)  # unwired: arg0
profileCatalog = TeklaTools.TeklaTools.ProfileCatalog()
